% Simulink data dictionary HRBData.sldd

A = Simulink.Parameter(7.20598, Unit="m^2")  % Aracın Ön Alanı
A_Tank = Simulink.Parameter(0.25, Unit="m^2")  % Yağ Tank Taban Alanı
Cd = Simulink.Parameter(0.8)  % Hava Sürtünmesi Katsayısı
Cr = Simulink.Parameter(0.018)  % Yuvarlanma Direnci Katsayısı (jazaar p.134)
DV = Simulink.Parameter(80, Unit="cm^3/rev")  % Deplasman
P0 = Simulink.Parameter(50, Unit="bar")  % Precharge Basıncı
Patm = Simulink.Parameter(1, Unit="bar")  % Atmosfer basıncı(tank basıncı atmosfer kabul edildi)
Pmax = Simulink.Parameter(400, Unit="bar")  % Maks Akümülatör Basıncı
R_AT = Simulink.Parameter(4.11)  % Araç-Teker Şaftı Aktarma Oranı
R_HA = Simulink.Parameter(7)  % Hidromotor-Araç Şaftı Aktarma Oranı
R_PM_Aku = Simulink.Parameter(0.07)  % Pompa/Motor ve Tank Arasındaki Bileşenlerin Hidrolik Direnç Katsayısı
V0 = Simulink.Parameter(0.06, Unit="m^3")  % Akümülator Hacmi
V_oil = Simulink.Parameter(0.1, Unit="m^3")  % Sistemdeki Toplam Yağ Hacmi
alpha = Simulink.Parameter(0, Unit="deg")  % Eğim Açısı
g = Simulink.Parameter(9.81, Unit="m^2/s")  % Yerçekimi İvmesi
gamma = Simulink.Parameter(1.4)  % Polytropic Gaz Katsayısı
m = Simulink.Parameter(18000, Unit="kg")  % Araç Kütlesi
mech_eff = Simulink.Parameter(0.9)  % Mekanik Pompa Verimi
mu_AT = Simulink.Parameter(0.8)  % Araç-Teker Şaftı Aktarma Verimi
mu_HA = Simulink.Parameter(0.8)  % Hidromotor-Araç Şaftı Aktarma Verimi
r = Simulink.Parameter(0.5715, Unit="m")  % Tekerlek Yarıçapı
rho = Simulink.Parameter(1.225, Unit="kg/m^3")  % Hava Yoğunluğu
rho_oil = Simulink.Parameter(700, Unit="kg/m^3")  % Yağ Yoğunluğu
vol_eff = Simulink.Parameter(0.9)  % Hacimsel Verim
T_sim = Simulink.Parameter(50, Unit="sec")  % Simülasyon süresi
act_time = Simulink.Parameter(10, Unit="sec")  % Pompa/Motor ünitesinin deplasmanı sonuna kadar açılana kadar geçen süre
P1 = Simulink.Parameter(60, Unit="bar")  % Akümülatörün simülasyon başındaki basıncı
ilk_hiz = Simulink.Parameter(15, Unit="m/s")  % Aracın simülasyon başındaki hızı